# Grasshopper definition MainFile.gh (Grasshopper 1.0.7)
# plug-ins: BH.UI.Grasshopper, Human, Hops

getinfo = GetInfo(Component="{ .GetInfo")
# <Script name>
project_number = Panel("")
setprojectid = SetProjectID(ProjectID=project_number, Component="{ .SetProjectID")
bhom_version_used_to_create = Panel("7.1")
bhom_version_currently_installed = Panel(getinfo)

# ---- group: 1.0 Define Context / Waypoints
crv = Curve(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)
divide = DivideCurve(Curve=crv, Count=Slider(4, range=0..10), Kinks=False)  # -> Points, Tangents, Parameters

# ---- group: 1.0 Define Context / Boundary
panel = Panel("300")
merge = Merge(Data1="0", Data2=panel)

# ---- group: 1.0 Define Context
crv_2 = Curve(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)
explode = Explode(Curve=crv_2, Recursive=True)  # -> Segments, Vertices

# ---- group: 1.0 Define Context / Obstacle
crv_3 = Curve([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])

# ---- group: 1.0 Define Context
explode_2 = Explode(Curve=crv_3, Recursive=True)  # -> Segments, simplify(Vertices)

# ----
pt = Point([Point(56.75468783, 68.98138072, 0), Point(80.32848913, 103.6487356, 0), Point(119.5026001, 64.47462458, 0), Point(169.0769176, 92.55518202, 0)])

# ---- group: 1.0 Define Context
# 01
# CREATE
# CONTEXT
panel_2 = Panel("test")
python = GhPythonScript(
    versionInp="1.1",
    nameInp=panel_2,
    x_marginInp=merge,
    y_marginInp=merge,
    ped_routesInp=pt,
    crowded_zonesInp=explode.Vertices,
    obstaclesInp=explode_2.Vertices,
    Run=Toggle(False))  # -> out, a; inputs x_marginInp: list of Int32, y_marginInp: list of Int32, ped_routesInp: list of Point3d, crowded_zonesInp: list of Point3d, obstaclesInp: tree of Point3d, Run: Boolean
# ---------- python: Python ----------
__author__ = "ebendo"
__version__ = "2024.04.17"

import rhinoscriptsyntax as rs
import json
from collections import OrderedDict
import ghpythonlib.treehelpers as th



def GetVertexCoord(rhinoPoints, last):
    points=[]
    for i in range(len(rhinoPoints)):
        point=[]
        point.append(int(rhinoPoints[i][0]))
        point.append(int(y_marginInp[1] - rhinoPoints[i][1])) #because the coordinate system is different
        points.extend([point])
    if(last):# I dont want to remove the last vertice in the case of waypoints
        points.pop()
    return points

def createObstacles(obstaclesInp):
    obstaclesJson=[]
    for i in range(obstaclesInp.BranchCount):
        obstacleTemp = OrderedDict()
        obstacleTemp["name"]="zone {0}".format(i)
        obstacleTemp["vertices"]= GetVertexCoord(obstaclesInp.Branch(i), True)
        print(obstacleTemp)
        obstaclesJson.append(obstacleTemp)
    return obstaclesJson

waypoints=GetVertexCoord(ped_routesInp, False)
crowded_zones=GetVertexCoord(crowded_zonesInp, True)
crowded_zones.pop() #rectangles in the library are only defined by the first 3 vertices
obstacles=createObstacles(obstaclesInp)

def create_json(version, name, x_margin, y_margin, waypoints, crowded_zones, obstacles):
    json_data = OrderedDict()
    json_data["version"] = version
    json_data["name"] = name
    json_data["bounds"] = OrderedDict()
    json_data["bounds"]["x_margin"] = x_margin
    json_data["bounds"]["y_margin"] = y_margin
    
    ped_routes = [
    OrderedDict({
        "name": "route_1",
        "waypoints": waypoints,
        "reversible": True
        })
    ]
    crowded_zones = [
        OrderedDict({
            "name": "zone_1",
            "zone_rect": crowded_zones
        })
    ]
    json_data["ped_routes"] = ped_routes
    json_data["crowded_zones"] = crowded_zones
    json_data["obstacles"] = obstacles
    return json.dumps(json_data, indent=4)

print(y_marginInp[1])
# Generate JSON
if(Run):
    output_json = create_json(versionInp, nameInp, x_marginInp, y_marginInp, waypoints, crowded_zones, obstacles)
    a=output_json
    # Save JSON to file
    file_path = "C:\Users\ebendo\Documents\GitHub\PySocialForce\maps\GHMap.json"  # Define the file path where you want to save the JSON
    with open(file_path, "w") as f:
        f.write(output_json)
    
    print("JSON saved to", file_path)
# ---------- end python ----------

# ---- group: Get Starting Points
# 02
# SET
# PEDESTRIAN
# LOCATIONS
rec = Rectangle({Plane=PlaneXY(32.68649661, 35.50617937, 0), Size=Domain2(u=-13.05477995..13.05477995, v=-12.57126958..12.57126958)})  # disabled
pop2d = Populate2D(Region=rec, Count=100, Seed=1)  # disabled
pt_2 = Point([Point(59.78373769, 35.65805689, 0), Point(52.86859988, 38.67234773, 0), Point(25.91729354, 52.1480009, 0), Point(36.20134464, 63.49591936, 0), Point(46.66270697, 64.73709794, 0), Point(45.95346207, 79.80855215, 0), Point(20.77526799, 68.81525614, 0)])
python_2 = GhPythonScript(Points=pt_2, write=Toggle(True), y_margin=merge)  # -> out, a; inputs Points: list of Point3d, write: Boolean, y_margin: list of Int32
# ---------- python_2: Python ----------
__author__ = "ebendo"
__version__ = "2024.05.15"

import rhinoscriptsyntax as rs
import json
from collections import OrderedDict

point_data = []
for i in range(len(Points)):
    point_dict = OrderedDict()
    point_dict["x"]=round(Points[i][0],2)
    point_dict["y"]=y_margin[1]-round(Points[i][1],2)#200 because of boundary
    
    point_data.append(point_dict)

if(write):
    json_data = json.dumps(point_data, indent=4)
    a=json_data

    # Save JSON to file
    file_path = "C:\Users\ebendo\Documents\GitHub\PySocialForce\maps\peds.json"
    with open(file_path, "w") as f:
        f.write(json_data)
    print("JSON saved to", file_path)
# ---------- end python_2 ----------

# ----
pdecon = Deconstruct(Point=pt_2)  # -> XComponent, YComponent, ZComponent
panel_3 = Panel(pdecon.XComponent)
panel_4 = Panel(python_2.out)

# ---- group: Grid Visualization
scale = Slider(2, range=0..10)
number_slider = Slider(5, range=0..1000)

# ---- group: PLAY
number_slider_2 = Slider(2500, range=0..2500)

# ---- group: TIME
number_slider_3 = Slider(5000, range=0..10000)

# ----
# 03
# SIMULATE
toggle = BooleanToggle(False)
hops = Hops(
    Step=number_slider_3,
    Simulate=toggle,
    Margin=panel,
    CacheResultsInMemory=False,
    CacheSolveResults=False,
    RemoteDefinitionLocation="http://127.0.0.1:5000/simulate",
    RemoteSolveVersion=(0, 1, 0),
    ShowInput_Enabled=False,
    ShowInput_Path=False,
    SynchronousSolve=True)
pt_3 = Point(hops)

panel_5 = Panel(python_2.a)
panel_6 = Panel(hops)

# ---- group: Paths
# 04
# VISUALIZE
lng = ListLength(List=pt_3)
division = Division(A=lng, B=number_slider_3)
subtraction = Subtraction(A=number_slider_3, B=number_slider_2)
partition = PartitionList(List=pt_3, Size=division)  # -> simplify(Chunks)
flip = FlipMatrix(Data=partition)
shift = ShiftList(List=reverse(flip), Shift=subtraction, Wrap=False)
pline = PolyLine(Vertices=shift, Closed=False)

# ---- group: Pedestrians
number_slider_4 = Slider(0, range=0..5000)
branch = TreeBranch(Tree=partition, Path=number_slider_2, MaintainPaths=True)
pt_4 = Point(branch)

# ---- group: Grid
division_2 = Division(A=panel, B=scale)
crv_4 = Curve(pline)
divlength = DivideLength(Curve=crv_4, Length=expr("x-0.5", scale))  # -> flatten(Points), Tangents, Parameters
item = ListItem(List=divlength.Points, Index=0, Wrap=True)
sqgrid = Square(Plane=PlaneXY(0, 0, 0), Size=scale, ExtentX=division_2, ExtentY=division_2)  # -> flatten(Cells), Points
pdecon_2 = Deconstruct(Point=divlength.Points)  # -> XComponent, YComponent, ZComponent
path = Division(A=pdecon_2.XComponent, B=scale)  # -> flatten(Result)
item_2 = Division(A=pdecon_2.YComponent, B=scale)  # -> flatten(Result)
round = Round(Number=path)  # -> Nearest, Floor, Ceiling
round_2 = Round(Number=item_2)  # -> Nearest, Floor, Ceiling
expression = Expression(x=round.Floor, y=round_2.Floor, num=division_2, Expression="x*num+y")
item_3 = ListItem(List=sqgrid.Cells, Index=expression, Wrap=True)
pcen = PolygonCenter(Polyline=item_3)  # -> CenterV, CenterE, CenterA
cset = CreateSet(List=pcen.CenterV)  # -> Set, Map
mindex = MemberIndex(Set=pcen.CenterV, Member=cset.Set)  # -> Index, Count
item_4 = ListItem(List=mindex.Index, Index=0, Wrap=True)  # -> flatten(Item)
item_5 = ListItem(List=item_3, Index=item_4, Wrap=True)  # -> flatten(Item)

# ---- group: DISPLAY
number_slider_5 = Slider(1, range=0..10)
bnd = Bounds(Numbers=flatten(mindex.Count))
dedomain = DeconstructDomain(Domain=bnd)  # -> Start, End
cir = Circle(Plane=branch, Radius=number_slider_5)
cir_2 = Circle(Plane=pt_2, Radius=number_slider_5)
rectangle = Rectangle(Plane=PlaneXY(0, 0, 0), XSize=panel, YSize=panel, Radius=0)  # -> Rectangle, Length
boundary = BoundarySurfaces(Edges=crv_2)
cir_3 = Circle(Plane=pt, Radius=Slider(4, range=0..10))
boundary_2 = BoundarySurfaces(Edges=crv_3)
number_slider_6 = Slider(0.3, range=0..1)
move = Move(Geometry=boundary_2, Motion=Vector(0, 0, 10))  # -> Geometry, Transform
boundary_3 = BoundarySurfaces(Edges=cir)
boundary_4 = BoundarySurfaces(Edges=cir_2)
boundary_5 = BoundarySurfaces(Edges=cir_3)
gradient = Gradient(
    LowerLimit=dedomain.Start,
    UpperLimit=number_slider,
    Parameter=mindex.Count,
    stops=[0.0178: RGB(75, 107, 169), 0.251: RGB(173, 203, 249), 0.519: RGB(234, 126, 0), 0.775: RGB(254, 244, 84), 1: RGB(234, 38, 0)])
swatch = ColourSwatch(SwatchColor=RGB(36, 27, 255))
move_2 = Move(Geometry=boundary_4, Motion=Vector(0, 0, 10))  # -> Geometry, Transform
boundary_6 = BoundarySurfaces(Edges=item_5)
previewmat = CustomPreviewMaterials(Geometry=boundary_5, DiffuseColor=ColourSwatch(SwatchColor=RGB(255, 83, 255)), Transparency=number_slider_6)
previewlw = CustomPreviewLineweights(
    Geometry=rectangle.Rectangle,
    Shader=ColourSwatch(SwatchColor=RGB(0, 0, 0)),
    Thickness=Slider(1, range=0..1),
    Absolute=False)
previewmat_2 = CustomPreviewMaterials(Geometry=move_2.Geometry, DiffuseColor=swatch, Transparency=number_slider_6)
previewmat_3 = CustomPreviewMaterials(Geometry=boundary, DiffuseColor=RGB(255, 255, 255), Transparency=Slider(0.4, range=0..1))
preview = CustomPreview(Geometry=boundary_6, Material=gradient)
previewmat_4 = CustomPreviewMaterials(Geometry=boundary_3, DiffuseColor=swatch, Transparency=number_slider_6)
previewmat_5 = CustomPreviewMaterials(Geometry=move.Geometry, DiffuseColor=ColourSwatch(SwatchColor=RGB(113, 157, 181)))
previewlw_2 = CustomPreviewLineweights(Geometry=pline, Shader=ColourSwatch(SwatchColor=RGB(0, 0, 140)), Thickness=Slider(1, range=0..10), Absolute=False)

# ----
captureview = LBCaptureView(file_name=" base", viewport="Top", width="2000", height="2000", capture=Toggle(True))  # -> file; plug-in component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
